# Grasshopper definition practice_gh.gh (Grasshopper 1.0.7)

number_slider = Slider(52, range=1..100)
int = Integer(15)
divide = DivideCurve(Curve=<geometry referenced from the Rhino model>, Count=Slider(12, range=1..100), Kinks=False)  # -> Points, Tangents, Parameters
divide_2 = DivideCurve(Curve=<geometry referenced from the Rhino model>, Count=int, Kinks=False)  # -> Points, Tangents, Parameters
divide_3 = DivideCurve(Curve=<geometry referenced from the Rhino model>, Count=number_slider, Kinks=False)  # -> Points, Tangents, Parameters
divide_4 = DivideCurve(Curve=<geometry referenced from the Rhino model>, Count=number_slider, Kinks=False)  # -> Points, Tangents, Parameters
ln = Line(StartPoint=Point(-32.70091133, 48.08814019, 0), EndPoint=Point(147.4364182, 64.381969, 0))
divide_5 = DivideCurve(Curve=<geometry referenced from the Rhino model>, Count=int, Kinks=False)  # -> Points, Tangents, Parameters
pull = PullPoint(Point=divide.Points, Geometry=<curve referenced from the Rhino model>, ClosestOnly=True)  # -> ClosestPoint, Distance
pull_2 = PullPoint(Point=divide.Points, Geometry=<curve referenced from the Rhino model>, ClosestOnly=True)  # -> ClosestPoint, Distance
ln_2 = Line(StartPoint=divide_5.Points, EndPoint=divide_2.Points)
ln_3 = Line(StartPoint=divide_4.Points, EndPoint=divide_3.Points)
arc = Arc3Pt(PointA=pull.ClosestPoint, PointB=divide.Points, PointC=pull_2.ClosestPoint)  # -> Arc, Plane, Radius
